# Grasshopper definition LED_simulation.gh (Grasshopper 1.0.8)
# plug-ins: Bifocals

number_slider = Slider(2.82, range=0..10)  # disabled
number_slider_2 = Slider(2.82, range=0..10)  # disabled
# Audio Mapping
pt = Point(Point(0, 0, 0))  # disabled
# Audio Mapping + Movement (Play)
pt_2 = Point(Point(10.26394193, 0, 0))  # disabled
number_slider_3 = Slider(1.5, range=0..10)  # disabled
circle = CircleCNR(Center=pt, Normal=Vector(0, 0, 1), Radius=number_slider)  # disabled
circle_2 = CircleCNR(Center=pt_2, Normal=Vector(0, 0, 1), Radius=number_slider_2)  # disabled
# Audio Mapping + Movement (Play)
pt_3 = Point(Point(10.26394193, 0, 0))
len = Length(Curve=circle)  # disabled

# ---- group: entrance arc percentage
number_slider_4 = Slider(1.5, range=0..10)  # disabled
division = Division(A=number_slider_4, B=len)  # disabled
panel = Panel(division)  # disabled

# ----
len_2 = Length(Curve=circle_2)  # disabled
circle_3 = CircleCNR(Center=pt_3, Normal=Vector(0, 0, 1), Radius=Slider(2.82, range=0..10))
division_2 = Division(A=number_slider_3, B=len_2)  # disabled
panel_2 = Panel(len)  # disabled
panel_3 = Panel(len_2)  # disabled
len_3 = Length(Curve=circle_3)
panel_4 = Panel(division_2)  # disabled
division_3 = Division(A=Slider(1.5, range=0..10), B=len_3)
number_slider_5 = Slider(0.08636, range=0..0.1)  # disabled
panel_5 = Panel(len_3)
number_slider_6 = Slider(0.08636, range=0..0.1)  # disabled
panel_6 = Panel(division_3)
number_slider_7 = Slider(0, range=0..1)  # disabled
number_slider_8 = Slider(0, range=0..1)  # disabled
number_slider_9 = Slider(0.08636, range=0..0.1)
eval = EvaluateCurve(Curve=reparameterize(circle), Parameter=number_slider_5)  # -> Point, Tangent, Angle; disabled
eval_2 = EvaluateCurve(Curve=reparameterize(circle_2), Parameter=number_slider_6)  # -> Point, Tangent, Angle; disabled
number_slider_10 = Slider(0, range=0..1)
eval_3 = EvaluateCurve(Curve=reparameterize(circle), Parameter=number_slider_7)  # -> Point, Tangent, Angle; disabled
merge = Merge(Data1=number_slider_7, Data2=number_slider_5)  # disabled
eval_4 = EvaluateCurve(Curve=reparameterize(circle_2), Parameter=number_slider_8)  # -> Point, Tangent, Angle; disabled
merge_2 = Merge(Data1=number_slider_8, Data2=number_slider_6)  # disabled
eval_5 = EvaluateCurve(Curve=reparameterize(circle_3), Parameter=number_slider_9)  # -> Point, Tangent, Angle
shatter = Shatter(Curve=reparameterize(circle), Parameters=merge)  # disabled
eval_6 = EvaluateCurve(Curve=reparameterize(circle_3), Parameter=number_slider_10)  # -> Point, Tangent, Angle
shatter_2 = Shatter(Curve=reparameterize(circle_2), Parameters=merge_2)  # disabled
merge_3 = Merge(Data1=number_slider_10, Data2=number_slider_9)
len_4 = Length(Curve=shatter)  # disabled
panel_7 = Panel(shatter)  # disabled
len_5 = Length(Curve=shatter_2)  # disabled
panel_8 = Panel(shatter_2)  # disabled
shatter_3 = Shatter(Curve=reparameterize(circle_3), Parameters=merge_3)
panel_9 = Panel(len_4)  # disabled
panel_10 = Panel(len_5)  # disabled
len_6 = Length(Curve=shatter_3)
panel_11 = Panel(shatter_3)

# ---- group: booth wall arc
number_slider_11 = Slider(1, range=0..1)  # disabled
item = ListItem(List=shatter, Index=number_slider_11, Wrap=True)  # disabled

# ----
number_slider_12 = Slider(1, range=0..1)  # disabled
panel_12 = Panel(len_6)
item_2 = ListItem(List=shatter_2, Index=number_slider_12, Wrap=True)  # disabled

# ---- group: divide: center to center of strip
# if w = 0.012 m → pitch = 0.10 + 0.012 = 0.112 m
number_slider_13 = Slider(0.112, range=0..1)  # disabled
len_7 = Length(Curve=item)  # disabled
division_4 = Division(A=len_7, B=number_slider_13)  # disabled

# ----
number_slider_14 = Slider(0.112, range=0..1)  # disabled
item_3 = ListItem(List=shatter_3, Index=Slider(1, range=0..1), Wrap=True)
# if w = 0.012 m → pitch = 0.10 + 0.012 = 0.112 m
len_8 = Length(Curve=item_2)  # disabled
# if w = 0.012 m → pitch = 0.10 + 0.012 = 0.112 m
len_9 = Length(Curve=item_3)
division_5 = Division(A=len_8, B=number_slider_14)  # disabled

# ---- group: Pixel division
# 60 pixels/m
number_slider_15 = Slider(0.7, range=0..1)  # disabled
# 146 vertical strips
divide = DivideCurve(Curve=item, Count=division_4, Kinks=False)  # -> Points, Tangents, Parameters; disabled
number_slider_16 = Slider(41, range=0..100)  # disabled
line = LineSDL(Start=divide.Points, Direction=Vector(0, 0, 1), Length=number_slider_15)  # disabled
# E:\Documents (E)\IAAC-Spain\1_YEAR 2025-2026\Semester_02\AI for ALL\spectrogram_to_csv\waveform.csv
# E:\Documents (E)\IAAC-Spain\1_YEAR 2025-2026\Semester_02\AI for ALL\spectrogram_to_csv\waveform_2.csv
divide_2 = DivideCurve(Curve=line, Count=number_slider_16, Kinks=False)  # -> Points, Tangents, Parameters; disabled

# ----
division_6 = Division(A=len_9, B=Slider(0.112, range=0..1))
number_slider_17 = Slider(0.7, range=0..1)  # disabled
# 146 vertical strips
divide_3 = DivideCurve(Curve=item_2, Count=division_5, Kinks=False)  # -> Points, Tangents, Parameters; disabled
# 146 vertical strips
divide_4 = DivideCurve(Curve=item_3, Count=division_6, Kinks=False)  # -> Points, Tangents, Parameters
# 60 pixels/m
number_slider_18 = Slider(41, range=0..100)  # disabled
line_2 = LineSDL(Start=divide_3.Points, Direction=Vector(0, 0, 1), Length=number_slider_17)  # disabled
# 60 pixels/m
number_slider_19 = Slider(41, range=0..100)
line_3 = LineSDL(Start=divide_4.Points, Direction=Vector(0, 0, 1), Length=Slider(0.7, range=0..1))
divide_5 = DivideCurve(Curve=line_2, Count=number_slider_18, Kinks=False)  # -> Points, Tangents, Parameters; disabled
# E:\Documents (E)\IAAC-Spain\1_YEAR 2025-2026\Semester_02\AI for ALL\spectrogram_to_csv\waveform_2.csv
panel_13 = Panel("E:\Documents (E)\IAAC-Spain\1_YEAR 2025-2026\Semester_02\AI for ALL\spectrogram_to_csv\waveform.csv")  # disabled
divide_6 = DivideCurve(Curve=line_3, Count=number_slider_19, Kinks=False)  # -> Points, Tangents, Parameters
number_slider_20 = Slider(1, range=1..30)  # disabled
number_slider_21 = Slider(0, range=0..145)  # disabled
# E:\Documents (E)\IAAC-Spain\1_YEAR 2025-2026\Semester_02\AI for ALL\spectrogram_to_csv\waveform_2.csv
panel_14 = Panel("E:\Documents (E)\IAAC-Spain\1_YEAR 2025-2026\Semester_02\AI for ALL\spectrogram_to_csv\waveform.csv")
panel_15 = Panel("10")  # disabled
panel_16 = Panel("30")  # disabled
py3 = Python3Script(ledPts=divide_2.Points)  # -> ptsFlat, colors, debug; inputs path: String, ledPts: tree of Point3d; disabled
# ---------- py3: Python ----------
import csv, os
from System.Drawing import Color

# -------------------------
# 1) Read waveform.csv
# -------------------------
if not isinstance(path, str) or not os.path.exists(path):
    raise Exception("Bad path or file not found:\n" + str(path))

spec = []
with open(path, "r") as f:
    r = csv.reader(f)
    for row in r:
        if row:
            spec.append([float(x) for x in row])

if not spec:
    raise Exception("CSV is empty")

n_strips = len(spec)          # should be 146
n_leds = len(spec[0])         # should be 42
need = n_strips * n_leds

# -------------------------
# 2) Collect ALL LED points robustly (ignores weird tree nesting)
# -------------------------
flat_pts = []

def is_point(obj):
    return hasattr(obj, "X") and hasattr(obj, "Y") and hasattr(obj, "Z")

def walk(obj):
    # GH tree case
    if hasattr(obj, "Branches"):
        br = obj.Branches
        for i in range(br.Count):
            walk(br[i])
        return
    # Iterable case (lists/nested)
    if hasattr(obj, "__iter__") and not is_point(obj) and not isinstance(obj, (str, bytes)):
        for it in obj:
            walk(it)
        return
    # Point case
    if is_point(obj):
        flat_pts.append(obj)
        return

walk(ledPts)

if len(flat_pts) != need:
    raise Exception(
        f"Point count mismatch:\nHave {len(flat_pts)} points\nNeed {need} ({n_strips} x {n_leds})"
    )

# -------------------------
# 3) Map 0/1 waveform to colors (no gradient needed)
# -------------------------
ptsFlat = flat_pts

# Build values strip-by-strip then color them
vals = [spec[i][j] for i in range(n_strips) for j in range(n_leds)]

colors = []
for v in vals:
    if v > 0.5:
        colors.append(Color.Yellow)                # waveform "ON"
    else:
        colors.append(Color.FromArgb(25,25,25))  # background dim

vmin = min(vals)
vmax = max(vals)
debug = f"OK. CSV={n_strips}x{n_leds}, pts={len(ptsFlat)}, vals range={vmin}..{vmax}"
# ---------- end py3 ----------
py3_2 = Python3Script(path=panel_13, ledPts=divide_5.Points, t_sec=number_slider_20, win=panel_15, duration=panel_16, offset=number_slider_21)  # -> ptsFlat, colors, debug; inputs path: String, ledPts: tree of Point3d; disabled
# ---------- py3_2: Python ----------
import csv, os
from System.Drawing import Color

# ---- load waveform ----
if not isinstance(path, str) or not os.path.exists(path):
    raise Exception("Bad path or file not found:\n" + str(path))

spec = []
with open(path, "r") as f:
    r = csv.reader(f)
    for row in r:
        if row:
            spec.append([float(x) for x in row])

if not spec:
    raise Exception("CSV empty")

N = len(spec)       # 146
H = len(spec[0])    # 42
need = N * H

# ---- collect points robustly ----
flat_pts = []
def is_point(o): return hasattr(o,"X") and hasattr(o,"Y") and hasattr(o,"Z")
def walk(o):
    if hasattr(o, "Branches"):
        br = o.Branches
        for i in range(br.Count): walk(br[i])
        return
    if hasattr(o, "__iter__") and not is_point(o) and not isinstance(o,(str,bytes)):
        for it in o: walk(it)
        return
    if is_point(o): flat_pts.append(o)

walk(ledPts)

if len(flat_pts) != need:
    raise Exception(f"Point count mismatch: have {len(flat_pts)} need {need} ({N}x{H})")

ptsFlat = flat_pts

# ---- playback index from seconds ----
duration = float(duration)
if duration <= 0: duration = 30.0

t_sec = float(t_sec)
# clamp to [0, duration]
if t_sec < 0: t_sec = 0
if t_sec > duration: t_sec = duration

raw_t = int((t_sec / duration) * (N-1))  # 0..N-1
offset = int(offset) % N
t = (raw_t + offset) % N

win = int(win)
if win < 1: win = 1
if win > N: win = N
start = (t - win + 1) % N

# ---- colors ----
bg = Color.FromArgb(18,18,18)
on = Color.Cyan
head = Color.White

def in_window(i):
    if start <= t:
        return start <= i <= t
    else:
        return i >= start or i <= t

colors = []
for i in range(N):
    inside = in_window(i)
    for j in range(H):
        v = spec[i][j]
        if i == t:
            colors.append(head if v > 0.5 else Color.FromArgb(35,35,35))
        elif inside:
            colors.append(on if v > 0.5 else bg)
        else:
            colors.append(bg)

debug = f"N={N}, H={H}, t_sec={t_sec:.2f}/{duration}, raw_t={raw_t}, t={t}, win={win}, offset={offset}"
# ---------- end py3_2 ----------
panel_17 = Panel("0.01")  # disabled
py3_3 = Python3Script(
    path=panel_14,
    ledPts=divide_6.Points,
    t_sec=Slider(30, range=0..30),
    win="10",
    duration="30",
    offset=Slider(0, range=0..145))  # -> ptsFlat, colors, debug; inputs path: String, ledPts: tree of Point3d
# ---------- py3_3: Python ----------
import csv, os
from System.Drawing import Color

# -------------------------
# 1) Read waveform CSV (rows=strips, cols=leds)
# -------------------------
if not isinstance(path, str) or not os.path.exists(path):
    raise Exception("Bad path or file not found:\n" + str(path))

spec = []
with open(path, "r") as f:
    r = csv.reader(f)
    for row in r:
        if row:
            spec.append([float(x) for x in row])

if not spec:
    raise Exception("CSV is empty")

N = len(spec)        # 146 strips
H = len(spec[0])     # 42 leds per strip
need = N * H

# -------------------------
# 2) Collect ALL points robustly (ignores tree weirdness)
# -------------------------
flat_pts = []

def is_point(o):
    return hasattr(o, "X") and hasattr(o, "Y") and hasattr(o, "Z")

def walk(o):
    if hasattr(o, "Branches"):           # GH tree
        br = o.Branches
        for i in range(br.Count):
            walk(br[i])
        return
    if hasattr(o, "__iter__") and not is_point(o) and not isinstance(o, (str, bytes)):
        for it in o:
            walk(it)
        return
    if is_point(o):
        flat_pts.append(o)

walk(ledPts)

if len(flat_pts) != need:
    raise Exception(f"Point count mismatch: have {len(flat_pts)} need {need} ({N}x{H})")

ptsFlat = flat_pts

# -------------------------
# 3) Time -> strip index (cumulative reveal)
# -------------------------
duration = float(duration) if duration else 30.0
if duration <= 0: duration = 30.0

t_sec = float(t_sec) if t_sec is not None else 0.0
if t_sec < 0: t_sec = 0
if t_sec > duration: t_sec = duration

# progress strip index 0..N-1
t_idx = int((t_sec / duration) * (N - 1))

# offset rotates where "strip 0" is around the ring (use it to align to opening)
offset = int(offset) % N

# We will *display* strip i at geometry strip (i + offset) % N
# so that i=0 can be placed at the opening start by choosing offset.
def geom_strip_index(i):
    return (i + offset) % N

# -------------------------
# 4) Colors: cumulative reveal
# -------------------------
bg = Color.FromArgb(18, 18, 18)       # background dim
offpix = Color.FromArgb(25, 25, 25)   # dim inside revealed strips
on = Color.Cyan                       # waveform ON
head = Color.White                    # current strip highlight (optional)

HIGHLIGHT_HEAD = True

colors = [bg] * (N * H)

# Reveal strips from 0..t_idx
for i in range(0, t_idx + 1):
    gi = geom_strip_index(i)  # where this strip lands on the ring

    for j in range(H):
        v = spec[i][j]        # IMPORTANT: use spec time order i
        idx = gi * H + j      # flat indexing: strip-major order

        if v > 0.5:
            colors[idx] = head if (HIGHLIGHT_HEAD and i == t_idx) else on
        else:
            # keep pixels dim but "present" in revealed region
            colors[idx] = Color.FromArgb(35, 35, 35) if (HIGHLIGHT_HEAD and i == t_idx) else offpix

debug = f"OK cumulative. N={N}, H={H}, t_sec={t_sec:.2f}/{duration}, t_idx={t_idx}, offset={offset}"
# ---------- end py3_3 ----------
panel_18 = Panel("0.01")  # disabled
sph = Sphere(Base=py3.ptsFlat, Radius=panel_17)  # disabled
sph_2 = Sphere(Base=PlaneXY(0, 0, 0), Radius=panel_18)  # disabled
preview = CustomPreview(Geometry=sph, Material=py3.colors)  # disabled
preview_2 = CustomPreview(Geometry=py3_2.ptsFlat, Material=py3_2.colors)  # disabled
sph_3 = Sphere(Base=PlaneXY(0, 0, 0), Radius="0.01")
preview_3 = CustomPreview(Geometry=py3_3.ptsFlat, Material=py3_3.colors)
